# Grasshopper definition lul_assignment-1.gh (Grasshopper 1.0.8)
# plug-ins: Human, LunchBox

# ---- group: Parameters Var 1
gaps_enabled_offene_regalfelder = BooleanToggle(False)
width = Slider(112.65, range=80..160)
height = Slider(80, range=80..160)
depth = Slider(15.31, range=15..40)
thickness = Slider(1, range=1..3)
radius = Slider(0.3, range=0.3..1.2)
mode = Slider(0, range=0..2)
tower_height_turmhoehe = Slider(0.1, range=0..0.5)

# ---- group: Auto-reloads cdf module on VScode changes
# Setting path for Src AutoReloader: 1. Right click on Path
# 2. Choose "Select a directory"
# 3. Locate the ..\cdf1_teaching\src folder in your computer
path = FilePath("/Users/spukki/Documents/GitHub/cdf1_teaching/src/")
autoreloader = Python3Script(src_path=path)  # -> out; inputs src_path: String
# ---------- autoreloader: Python ----------
#! python3
import sys, os, time
import scriptcontext as sc
import Rhino, System
from System.IO import FileSystemWatcher, NotifyFilters

VERSION = 1  
pkg = "cdf"

if not src_path:
    raise Exception("Connect a folder to src_path.")
path = os.path.normpath(src_path)
watch_dir = os.path.join(path, pkg)
if not os.path.isdir(watch_dir):
    raise Exception("No '{}' folder found in:\n{}".format(pkg, path))

def unload():
    for name in list(sys.modules):
        if name == pkg or name.startswith(pkg + "."):
            del sys.modules[name]

# Put this folder first in Python's search list
if path in sys.path:
    sys.path.remove(path)
sys.path.insert(0, path)

key = "cdf_watcher_" + str(ghenv.Component.InstanceGuid)
time_key = key + "_time"
version_key = key + "_version"

def stamp():
    sc.sticky[time_key] = time.strftime("%Y-%m-%d %H:%M:%S")

# Replace the old watcher if the folder changed or the script was updated
old = sc.sticky.get(key)
if old is not None and (os.path.normpath(old.Path) != watch_dir
                        or sc.sticky.get(version_key) != VERSION):
    old.Dispose()
    del sc.sticky[key]
    unload()

if key not in sc.sticky:
    comp = ghenv.Component
    last = [0.0]

    def reload_and_rerun():
        unload()
        stamp()
        doc = comp.OnPingDocument()
        if doc is None:            # reloader was deleted or the file closed
            return
        for obj in doc.Objects:
            if "Python" in obj.GetType().Name:
                obj.ExpireSolution(False)   # mark as out of date
        doc.NewSolution(False)              # recompute once

    def on_change(sender, e):
        if not e.FullPath.endswith(".py") or "__pycache__" in e.FullPath:
            return
        if time.time() - last[0] < 0.5:     # ignore the second event of a double save
            return
        last[0] = time.time()
        Rhino.RhinoApp.InvokeOnUiThread(System.Action(reload_and_rerun))

    w = FileSystemWatcher(watch_dir, "*.py")
    w.IncludeSubdirectories = True
    w.NotifyFilter = NotifyFilters.LastWrite
    w.Changed += on_change
    w.EnableRaisingEvents = True
    sc.sticky[key] = w
    sc.sticky[version_key] = VERSION
    stamp()                                  # time the watcher started

msg = "Last reloaded: {}\nWatching: {}".format(sc.sticky.get(time_key, "unknown"), watch_dir)
print(msg)
out = msg
# ---------- end autoreloader ----------
panel = Panel(autoreloader)

# ---- group: Parameters Var 2
gaps_enabled_offene_regalfelder_2 = BooleanToggle(True)
width_2 = Slider(112.65, range=80..160)
height_2 = Slider(80, range=80..160)
depth_2 = Slider(15.31, range=15..40)
thickness_2 = Slider(1, range=1..3)
radius_2 = Slider(0.3, range=0.3..1.2)
mode_2 = Slider(0, range=0..2)
tower_height_turmhoehe_2 = Slider(0.1, range=0..0.5)

# ---- group: Parameters Var 3
gaps_enabled_offene_regalfelder_3 = BooleanToggle(True)
width_3 = Slider(90, range=80..160)
height_3 = Slider(60, range=60..160)
depth_3 = Slider(20, range=15..40)
thickness_3 = Slider(1, range=1..3)
radius_3 = Slider(0.3, range=0.3..1.2)
mode_3 = Slider(1, range=0..2)
tower_height_turmhoehe_3 = Slider(0.1, range=0..0.5)

# ---- group: Regal
# Parametric Bauhaus shelving composition
wall_origin = Point(Point(1550, 0, 0))
thickness_4 = Slider(1, range=1..3)
gaps_enabled_offene_regalfelder_4 = BooleanToggle(True)
height_4 = Slider(83.31, range=60..160)
depth_4 = Slider(16.79, range=15..40)
radius_4 = Slider(0.3, range=0.3..1.2)
mode_4 = Slider(0, range=0..2)
tower_height_turmhoehe_4 = Slider(0.1, range=0..0.5)
width_4 = Slider(130.61, range=80..160)
fachraster = Python3Script(
    origin=wall_origin,
    width=width_4,
    height=height_4,
    depth=depth_4,
    mode=mode_4,
    gaps_enabled=gaps_enabled_offene_regalfelder_4,
    tower_height=tower_height_turmhoehe_4)  # -> out, planes, widths, starts, ends, xs, zs, occupied; inputs origin: Point3d, width: Double, height: Double, depth: Double, mode: Int32, gaps_enabled: Boolean, tower_height: Double
# ---------- fachraster: Python ----------
import cdf.geometry_basics as geometry_basics

planes, widths, starts, ends, xs, zs, occupied = geometry_basics.create_shelf_grid(
    origin=origin,
    width=width,
    height=height,
    depth=depth,
    mode=mode,
    gaps_enabled=gaps_enabled,
    tower_height=tower_height,
)
# ---------- end fachraster ----------
regalboeden = Python3Script(planes=fachraster.planes, widths=fachraster.widths, depth=depth_4, thickness=thickness_4)  # -> out, a; inputs planes: list of Plane, widths: list of Double, depth: Double, thickness: Double
# ---------- regalboeden: Python ----------
import cdf.geometry_basics as geometry_basics

a = geometry_basics.create_shelf_boards(
    planes=planes,
    widths=widths,
    depth=depth,
    thickness=thickness,
)
# ---------- end regalboeden ----------
verbundene_rahmen_hoher_turm = Python3Script(start=fachraster.starts, end=fachraster.ends, radius=radius_4)  # -> out, a, axis, tip, direction; inputs start: Point3d, end: Point3d, radius: Double
# ---------- verbundene_rahmen_hoher_turm: Python ----------
import cdf.geometry_basics as geometry_basics

a, axis, tip, direction = geometry_basics.create_bauhaus_rod(
    start=start,
    end=end,
    radius=radius,
)
# ---------- end verbundene_rahmen_hoher_turm ----------
farbe = Colour(RGB(30, 30, 30))
farbe_2 = Colour(RGB(30, 30, 30))
preview = CustomPreview(Geometry=regalboeden.a, Material=farbe)
preview_2 = CustomPreview(Geometry=verbundene_rahmen_hoher_turm.a, Material=farbe_2)

# ---- group: Abmessungen
width_5 = Slider(10.8, range=0.01..32.4)
height_5 = Slider(0.756, range=0.01..5)
depth_5 = Slider(10.8, range=0.01..32.4)

# ----
width_6 = Slider(13.402545, range=0.01..40.207635)
height_6 = Slider(13.402545, range=0.01..40.207635)
depth_6 = Slider(2.010382, range=0.01..6.031145)

stellplaetze_auf_vorhandenen_boeden = Python3Script(
    origin=wall_origin,
    xs=fachraster.xs,
    zs=fachraster.zs,
    occupied=fachraster.occupied,
    depth=depth_4,
    thickness=thickness_4)  # -> out, feet, widths, heights, depths; inputs origin: Point3d, xs: list of Double, zs: list of Double, occupied: list of Int32, depth: Double, thickness: Double
# ---------- stellplaetze_auf_vorhandenen_boeden: Python ----------
import cdf.geometry_basics as geometry_basics

feet, widths, heights, depths = geometry_basics.create_shelf_catalog_slots(
    origin=origin,
    xs=xs,
    zs=zs,
    occupied=occupied,
    depth=depth,
    thickness=thickness,
)
# ---------- end stellplaetze_auf_vorhandenen_boeden ----------

# ---- group: Rautenfeld mit Attraktor
attractor_x_links_rechts = Slider(0.35, range=0..1)
attractor_y_vorne_hinten = Slider(0.4, range=0..1)
gap_near = Slider(0.03, range=0..0.15)
gap_far = Slider(0.45, range=0.2..0.65)
count = Slider(5, range=2..8)
influence = Slider(0.34, range=0.1..1.5)
size_gesamtfaktor = Slider(1, range=0.2..2)
pt = ConstructPoint(XCoordinate=attractor_x_links_rechts, YCoordinate=attractor_y_vorne_hinten, ZCoordinate=0)
rautenfeld_mit_attraktor = Python3Script(
    feet=stellplaetze_auf_vorhandenen_boeden.feet,
    size=size_gesamtfaktor,
    pull_point=pt,
    influence=influence,
    gap_near=gap_near,
    gap_far=gap_far,
    count=count,
    width=width_5,
    height=height_5,
    depth=depth_5)  # -> out, a, attractor, gaps; inputs feet: list of Point3d, size: Double, pull_point: Point3d, influence: Double, gap_near: Double, gap_far: Double, count: Int32, width: Double, height: Double, depth: Double
# ---------- rautenfeld_mit_attraktor: Python ----------
import cdf.geometry_basics as geometry_basics
import Rhino.Geometry as rg

a, attractor, gaps = geometry_basics.create_shelf_attractor_field(
    foot=feet[9], max_width=width, max_depth=width,
    max_height=width, scale=1.0, pull_point=pull_point,
    influence=influence, gap_near=gap_near, gap_far=gap_far, count=count,
)
t = rg.Transform.Scale(rg.Plane(feet[9], rg.Vector3d.ZAxis),
    size, size*depth/width, size*height/(0.35*width/count))
for body in a: body.Transform(t)
attractor.Transform(t)
# ---------- end rautenfeld_mit_attraktor ----------
farbe_3 = Colour(RGB(226, 178, 40))
preview_3 = CustomPreview(Geometry=rautenfeld_mit_attraktor.a, Material=farbe_3)
attraktor_auf_dem_brett = Point(rautenfeld_mit_attraktor.attractor)

# ---- group: Keil
size_gesamtfaktor_2 = Slider(1, range=0.2..2)
keil = Python3Script(feet=stellplaetze_auf_vorhandenen_boeden.feet, size=size_gesamtfaktor_2, width=width_6, height=height_6, depth=depth_6)  # -> out, a; inputs feet: list of Point3d, size: Double, width: Double, height: Double, depth: Double
# ---------- keil: Python ----------
import cdf.geometry_basics as geometry_basics

a = geometry_basics.create_shelf_object_dimensions(
    kind="wedge",
    foot=feet[6],
    width=width,
    height=height,
    depth=depth,
    size=size,
)
# ---------- end keil ----------
farbe_4 = Colour(RGB(30, 150, 175))
preview_4 = CustomPreview(Geometry=keil.a, Material=farbe_4)

# ---- group: Abmessungen
width_7 = Slider(10.304448, range=0.01..30.913344)
height_7 = Slider(13.739264, range=0.01..41.217792)
depth_7 = Slider(6.869632, range=0.01..20.608896)

# ---- group: Quader
size_gesamtfaktor_3 = Slider(1, range=0.2..2)
quader = Python3Script(feet=stellplaetze_auf_vorhandenen_boeden.feet, size=size_gesamtfaktor_3, width=width_7, height=height_7, depth=depth_7)  # -> out, a; inputs feet: list of Point3d, size: Double, width: Double, height: Double, depth: Double
# ---------- quader: Python ----------
import cdf.geometry_basics as geometry_basics

a = geometry_basics.create_shelf_object_dimensions(
    kind="box",
    foot=feet[3],
    width=width,
    height=height,
    depth=depth,
    size=size,
)
# ---------- end quader ----------
farbe_5 = Colour(RGB(81, 129, 231))
preview_5 = CustomPreview(Geometry=quader.a, Material=farbe_5)

# ---- group: Abmessungen
radius_5 = Slider(6.557376, range=0.01..19.672128)
depth_8 = Slider(1.639344, range=0.01..5)

# ---- group: Kreisscheibe mit Standkante
# OBJECT LIBRARY ON THE SHELF
size_gesamtfaktor_4 = Slider(1, range=0.2..2)
kreisscheibe_mit_standkante = Python3Script(feet=stellplaetze_auf_vorhandenen_boeden.feet, size=size_gesamtfaktor_4, radius=radius_5, depth=depth_8)  # -> out, a; inputs feet: list of Point3d, size: Double, radius: Double, depth: Double
# ---------- kreisscheibe_mit_standkante: Python ----------
import cdf.geometry_basics as geometry_basics

a = geometry_basics.create_shelf_object_dimensions(
    kind="flat_disc",
    foot=feet[0],
    radius=radius,
    depth=depth,
    size=size,
)
# ---------- end kreisscheibe_mit_standkante ----------
farbe_6 = Colour(RGB(193, 53, 44))
preview_6 = CustomPreview(Geometry=kreisscheibe_mit_standkante.a, Material=farbe_6)

# ---- group: Abmessungen
width_8 = Slider(6.897527, range=0.01..20.692581)
height_8 = Slider(11.036043, range=0.01..33.108129)
depth_9 = Slider(1.724382, range=0.01..5.173145)

# ---- group: Staebe
size_gesamtfaktor_5 = Slider(1.1, range=0.2..2)
staebe = Python3Script(feet=stellplaetze_auf_vorhandenen_boeden.feet, size=size_gesamtfaktor_5, width=width_8, height=height_8, depth=depth_9)  # -> out, a; inputs feet: list of Point3d, size: Double, width: Double, height: Double, depth: Double
# ---------- staebe: Python ----------
import cdf.geometry_basics as geometry_basics

a = geometry_basics.create_shelf_object_dimensions(
    kind="rods",
    foot=feet[12],
    width=width,
    height=height,
    depth=depth,
    size=size,
)
# ---------- end staebe ----------
farbe_7 = Colour(RGB(193, 53, 44))
preview_7 = CustomPreview(Geometry=staebe.a, Material=farbe_7)

# ---- group: Abmessungen
width_9 = Slider(8.758781, range=0.01..26.276342)
height_9 = Slider(8.758781, range=0.01..26.276342)
depth_10 = Slider(4.37939, range=0.01..13.138171)

# ---- group: Quader mit Ausschnitt
size_gesamtfaktor_6 = Slider(1, range=0.2..2)
quader_mit_ausschnitt = Python3Script(feet=stellplaetze_auf_vorhandenen_boeden.feet, size=size_gesamtfaktor_6, width=width_9, height=height_9, depth=depth_10)  # -> out, a; inputs feet: list of Point3d, size: Double, width: Double, height: Double, depth: Double
# ---------- quader_mit_ausschnitt: Python ----------
import cdf.geometry_basics as geometry_basics

a = geometry_basics.create_shelf_object_dimensions(
    kind="cut_box",
    foot=feet[15],
    width=width,
    height=height,
    depth=depth,
    size=size,
)
# ---------- end quader_mit_ausschnitt ----------
farbe_8 = Colour(RGB(81, 129, 231))
preview_8 = CustomPreview(Geometry=quader_mit_ausschnitt.a, Material=farbe_8)

# ---- group: Abmessungen
radius_6 = Slider(5.16, range=0.01..15.48)
height_10 = Slider(10.32, range=0.01..30.96)

# ---- group: Kegel
size_gesamtfaktor_7 = Slider(1, range=0.2..2)
kegel = Python3Script(feet=stellplaetze_auf_vorhandenen_boeden.feet, size=size_gesamtfaktor_7, radius=radius_6, height=height_10)  # -> out, a; inputs feet: list of Point3d, size: Double, radius: Double, height: Double
# ---------- kegel: Python ----------
import cdf.geometry_basics as geometry_basics

a = geometry_basics.create_shelf_object_dimensions(
    kind="cone",
    foot=feet[4],
    radius=radius,
    height=height,
    size=size,
)
# ---------- end kegel ----------
farbe_9 = Colour(RGB(193, 53, 44))
preview_9 = CustomPreview(Geometry=kegel.a, Material=farbe_9)

# ---- group: Abmessungen
radius_7 = Slider(5.57377, range=0.01..16.721309)
depth_11 = Slider(1.672131, range=0.01..5.016393)

width_10 = Slider(13.379111, range=0.01..40.137332)
height_11 = Slider(13.379111, range=0.01..40.137332)
depth_12 = Slider(2.006867, range=0.01..6.0206)

# ---- group: Raute
size_gesamtfaktor_8 = Slider(1, range=0.2..2)
raute = Python3Script(
    feet=stellplaetze_auf_vorhandenen_boeden.feet,
    size=size_gesamtfaktor_8,
    width=width_10,
    height=height_11,
    depth=depth_12)  # -> out, a; inputs feet: list of Point3d, size: Double, width: Double, height: Double, depth: Double
# ---------- raute: Python ----------
import cdf.geometry_basics as geometry_basics

a = geometry_basics.create_shelf_object_dimensions(
    kind="diamond",
    foot=feet[7],
    width=width,
    height=height,
    depth=depth,
    size=size,
)
# ---------- end raute ----------
farbe_10 = Colour(RGB(81, 129, 231))
preview_10 = CustomPreview(Geometry=raute.a, Material=farbe_10)

# ---- group: Halbkreis
size_gesamtfaktor_9 = Slider(1, range=0.2..2)
halbkreis = Python3Script(feet=stellplaetze_auf_vorhandenen_boeden.feet, size=size_gesamtfaktor_9, radius=radius_7, depth=depth_11)  # -> out, a; inputs feet: list of Point3d, size: Double, radius: Double, depth: Double
# ---------- halbkreis: Python ----------
import cdf.geometry_basics as geometry_basics

a = geometry_basics.create_shelf_object_dimensions(
    kind="half_disc",
    foot=feet[1],
    radius=radius,
    depth=depth,
    size=size,
)
# ---------- end halbkreis ----------
farbe_11 = Colour(RGB(226, 178, 40))
preview_11 = CustomPreview(Geometry=halbkreis.a, Material=farbe_11)

# ---- group: Abmessungen
width_11 = Slider(22.295078, range=0.01..66.885235)
height_12 = Slider(7.397221, range=0.01..22.191664)
depth_13 = Slider(1.608086, range=0.01..5)

radius_8 = Slider(5.57377, range=0.01..16.721309)
depth_14 = Slider(1.194379, range=0.01..5)

width_12 = Slider(8.758781, range=0.01..26.276342)
height_13 = Slider(8.758781, range=0.01..26.276342)
depth_15 = Slider(1.313817, range=0.01..5)

# ---- group: Kreisbogen
size_gesamtfaktor_10 = Slider(1, range=0.2..2)
kreisbogen = Python3Script(feet=stellplaetze_auf_vorhandenen_boeden.feet, size=size_gesamtfaktor_10, radius=radius_8, depth=depth_14)  # -> out, a; inputs feet: list of Point3d, size: Double, radius: Double, depth: Double
# ---------- kreisbogen: Python ----------
import cdf.geometry_basics as geometry_basics

a = geometry_basics.create_shelf_object_dimensions(
    kind="arc",
    foot=feet[13],
    radius=radius,
    depth=depth,
    size=size,
)
# ---------- end kreisbogen ----------
farbe_12 = Colour(RGB(226, 178, 40))
preview_12 = CustomPreview(Geometry=kreisbogen.a, Material=farbe_12)

# ---- group: Sinusband
size_gesamtfaktor_11 = Slider(1, range=0.2..2)
sinusband = Python3Script(
    feet=stellplaetze_auf_vorhandenen_boeden.feet,
    size=size_gesamtfaktor_11,
    width=width_11,
    height=height_12,
    depth=depth_13)  # -> out, a; inputs feet: list of Point3d, size: Double, width: Double, height: Double, depth: Double
# ---------- sinusband: Python ----------
import cdf.geometry_basics as geometry_basics

a = geometry_basics.create_shelf_object_dimensions(
    kind="sine_band",
    foot=feet[10],
    width=width,
    height=height,
    depth=depth,
    size=size,
)
# ---------- end sinusband ----------
farbe_13 = Colour(RGB(30, 150, 175))
preview_13 = CustomPreview(Geometry=sinusband.a, Material=farbe_13)

# ---- group: L-Profil
size_gesamtfaktor_12 = Slider(1, range=0.2..2)
l_profil = Python3Script(
    feet=stellplaetze_auf_vorhandenen_boeden.feet,
    size=size_gesamtfaktor_12,
    width=width_12,
    height=height_13,
    depth=depth_15)  # -> out, a; inputs feet: list of Point3d, size: Double, width: Double, height: Double, depth: Double
# ---------- l_profil: Python ----------
import cdf.geometry_basics as geometry_basics

a = geometry_basics.create_shelf_object_dimensions(
    kind="custom_L",
    foot=feet[16],
    width=width,
    height=height,
    depth=depth,
    size=size,
)
# ---------- end l_profil ----------
farbe_14 = Colour(RGB(193, 53, 44))
preview_14 = CustomPreview(Geometry=l_profil.a, Material=farbe_14)

# ---- group: Abmessungen
width_13 = Slider(10.2, range=0.01..30.6)
height_14 = Slider(11.060289, range=0.01..33.180866)
depth_16 = Slider(10.2, range=0.01..30.6)

radius_9 = Slider(5.1, range=0.01..15.3)

# ---- group: Pyramide
size_gesamtfaktor_13 = Slider(1, range=0.2..2)
pyramide = Python3Script(
    feet=stellplaetze_auf_vorhandenen_boeden.feet,
    size=size_gesamtfaktor_13,
    width=width_13,
    height=height_14,
    depth=depth_16)  # -> out, a; inputs feet: list of Point3d, size: Double, width: Double, height: Double, depth: Double
# ---------- pyramide: Python ----------
import cdf.geometry_basics as geometry_basics

a = geometry_basics.create_shelf_object_dimensions(
    kind="pyramid",
    foot=feet[8],
    width=width,
    height=height,
    depth=depth,
    size=size,
)
# ---------- end pyramide ----------
farbe_15 = Colour(RGB(193, 53, 44))
preview_15 = CustomPreview(Geometry=pyramide.a, Material=farbe_15)

# ---- group: Abmessungen
radius_10 = Slider(4.37939, range=0.01..13.138171)
depth_17 = Slider(1.313817, range=0.01..5)

# ---- group: Kugel mit Standflaeche
size_gesamtfaktor_14 = Slider(1, range=0.2..2)
kugel_mit_standflaeche = Python3Script(feet=stellplaetze_auf_vorhandenen_boeden.feet, size=size_gesamtfaktor_14, radius=radius_9)  # -> out, a; inputs feet: list of Point3d, size: Double, radius: Double
# ---------- kugel_mit_standflaeche: Python ----------
import cdf.geometry_basics as geometry_basics

a = geometry_basics.create_shelf_object_dimensions(
    kind="sphere",
    foot=feet[5],
    radius=radius,
    size=size,
)
# ---------- end kugel_mit_standflaeche ----------
farbe_16 = Colour(RGB(226, 178, 40))
preview_16 = CustomPreview(Geometry=kugel_mit_standflaeche.a, Material=farbe_16)

# ---- group: Offener Ring
size_gesamtfaktor_15 = Slider(1, range=0.2..2)
offener_ring = Python3Script(feet=stellplaetze_auf_vorhandenen_boeden.feet, size=size_gesamtfaktor_15, radius=radius_10, depth=depth_17)  # -> out, a; inputs feet: list of Point3d, size: Double, radius: Double, depth: Double
# ---------- offener_ring: Python ----------
import cdf.geometry_basics as geometry_basics

a = geometry_basics.create_shelf_object_dimensions(
    kind="open_ring",
    foot=feet[2],
    radius=radius,
    depth=depth,
    size=size,
)
# ---------- end offener_ring ----------
farbe_17 = Colour(RGB(30, 150, 175))
preview_17 = CustomPreview(Geometry=offener_ring.a, Material=farbe_17)

# ---- group: Abmessungen
width_14 = Slider(17.517562, range=0.01..52.552685)
height_15 = Slider(1.751756, range=0.01..5.255268)
depth_18 = Slider(1.751756, range=0.01..5.255268)

radius_11 = Slider(5.1, range=0.01..15.3)
height_16 = Slider(5.1, range=0.01..15.3)

# ---- group: Strichreihe
size_gesamtfaktor_16 = Slider(1, range=0.2..2)
strichreihe = Python3Script(
    feet=stellplaetze_auf_vorhandenen_boeden.feet,
    size=size_gesamtfaktor_16,
    width=width_14,
    height=height_15,
    depth=depth_18)  # -> out, a; inputs feet: list of Point3d, size: Double, width: Double, height: Double, depth: Double
# ---------- strichreihe: Python ----------
import cdf.geometry_basics as geometry_basics

a = geometry_basics.create_shelf_object_dimensions(
    kind="dashes",
    foot=feet[11],
    width=width,
    height=height,
    depth=depth,
    size=size,
)
# ---------- end strichreihe ----------
farbe_18 = Colour(RGB(81, 129, 231))
preview_18 = CustomPreview(Geometry=strichreihe.a, Material=farbe_18)

# ---- group: Scheibenstapel
size_gesamtfaktor_17 = Slider(1, range=0.2..2)
scheibenstapel = Python3Script(feet=stellplaetze_auf_vorhandenen_boeden.feet, size=size_gesamtfaktor_17, radius=radius_11, height=height_16)  # -> out, a; inputs feet: list of Point3d, size: Double, radius: Double, height: Double
# ---------- scheibenstapel: Python ----------
import cdf.geometry_basics as geometry_basics

a = geometry_basics.create_shelf_object_dimensions(
    kind="disc_stack",
    foot=feet[14],
    radius=radius,
    height=height,
    size=size,
)
# ---------- end scheibenstapel ----------
farbe_19 = Colour(RGB(30, 150, 175))
preview_19 = CustomPreview(Geometry=scheibenstapel.a, Material=farbe_19)

# ---- group: Abmessungen
width_15 = Slider(14.100881, range=0.01..36)
height_17 = Slider(2.082361, range=0.01..7.875)
depth_19 = Slider(12.190963, range=0.01..36)

# ---- group: Punktraster
size_gesamtfaktor_18 = Slider(0.91, range=0.2..2)
punktraster = Python3Script(
    feet=stellplaetze_auf_vorhandenen_boeden.feet,
    size=size_gesamtfaktor_18,
    width=width_15,
    height=height_17,
    depth=depth_19)  # -> out, a; inputs feet: list of Point3d, size: Double, width: Double, height: Double, depth: Double
# ---------- punktraster: Python ----------
import cdf.geometry_basics as geometry_basics

a = geometry_basics.create_shelf_object_dimensions(
    kind="point_grid",
    foot=feet[17],
    width=width,
    height=height,
    depth=depth,
    size=size,
)
# ---------- end punktraster ----------
farbe_20 = Colour(RGB(226, 178, 40))
preview_20 = CustomPreview(Geometry=punktraster.a, Material=farbe_20)

# ---- group: Netzparameter
# Rautennetz, depending on the closest color to it
columns = Slider(20, range=3..20)
rows = Slider(20, range=3..24)
offset = Slider(1, range=0.3..15)
shift_x = Slider(0, range=-0.25..0.25)
shift_z = Slider(0, range=-0.25..0.25)
angle = Slider(30, range=-45..45)
shear = Slider(0.3, range=-0.5..0.5)
radius_12 = Slider(0.15, range=0.05..0.6)
sharpness = Slider(10, range=1..16)
blend_radius = Slider(20, range=0.1..25)

# ---- group: Rautenraster der Rückwand
rueckseite_aus_regalparametern = Python3Script(
    origin=wall_origin,
    width=width_4,
    height=height_4,
    depth=depth_4,
    tower_height=tower_height_turmhoehe_4,
    offset=offset,
    columns=columns,
    rows=rows)  # -> out, A, B, C, D, U, V, center, height; inputs origin: Point3d, width: Double, height: Double, depth: Double, tower_height: Double, offset: Double, columns: Int32, rows: Int32
# ---------- rueckseite_aus_regalparametern: Python ----------
import cdf.geometry_basics as geometry_basics

A,B,C,D,U,V,center,height = geometry_basics.shelf_net_frame(
    origin=origin,width=width,height=height,depth=depth,
    tower_height=tower_height,offset=offset,columns=columns,rows=rows,
)
# ---------- end rueckseite_aus_regalparametern ----------
srf4pt = _4PointSurface(
    CornerA=rueckseite_aus_regalparametern.A,
    CornerB=rueckseite_aus_regalparametern.B,
    CornerC=rueckseite_aus_regalparametern.C,
    CornerD=rueckseite_aus_regalparametern.D)
diamond = DiamondPanels(Surface=srf4pt, UDivisions=rueckseite_aus_regalparametern.U, VDivisions=rueckseite_aus_regalparametern.V)  # -> DiamondPanels, TriPanels
edges = BrepEdges(Brep=[diamond.DiamondPanels, diamond.TriPanels])  # -> Naked, Interior, NonManifold

# ---- group: Netzform und Netzstäbe
verschieben_schneiden_doppelte_entfernen = Python3Script(
    edges=flatten(edges.Naked),
    center=rueckseite_aus_regalparametern.center,
    width=width_4,
    height=rueckseite_aus_regalparametern.height,
    shift_x=shift_x,
    shift_z=shift_z,
    angle=angle,
    shear=shear)  # -> out, rails; inputs edges: list of Curve, center: Point3d, width: Double, height: Double, shift_x: Double, shift_z: Double, angle: Double, shear: Double
# ---------- verschieben_schneiden_doppelte_entfernen: Python ----------
import cdf.geometry_basics as geometry_basics

rails = geometry_basics.shelf_net_clip(
    edges=edges,center=center,width=width,height=height,
    shift_x=shift_x,shift_z=shift_z,angle=angle,shear=shear,
)
# ---------- end verschieben_schneiden_doppelte_entfernen ----------
pipe = Pipe(Curve=verschieben_schneiden_doppelte_entfernen.rails, Radius=radius_12, Caps=1, FitRail=False)
mesh = MeshBrep(
    Brep=pipe,
    Settings={GridMaxCount=0, GridMinCount=16, JaggedSeams=False, MaxEdgeLength=0, MinEdgeLength=0.0001, MinTolerance=0, Refine=True, RefineAngle=0, RelativeTolerance=0.65, SimplePlanes=True, Tolerance=0})

# ---- group: Farbverlauf aus Elementfarben
farbverlauf_aus_regalelementen = Python3Script(
    meshes=flatten(mesh),
    sharpness=sharpness,
    blend_radius=blend_radius,
    g0=flatten(kreisscheibe_mit_standkante.a),
    c0=farbe_6,
    g1=flatten(halbkreis.a),
    c1=farbe_11,
    g2=flatten(offener_ring.a),
    c2=farbe_17,
    g3=flatten(quader.a),
    c3=farbe_5,
    g4=flatten(kegel.a),
    c4=farbe_9,
    g5=flatten(kugel_mit_standflaeche.a),
    c5=farbe_16,
    g6=flatten(keil.a),
    c6=farbe_4,
    g7=flatten(raute.a),
    c7=farbe_10,
    g8=flatten(pyramide.a),
    c8=farbe_15,
    g9=flatten(rautenfeld_mit_attraktor.a),
    c9=farbe_3,
    g10=flatten(sinusband.a),
    c10=farbe_13,
    g11=flatten(strichreihe.a),
    c11=farbe_18,
    g12=flatten(staebe.a),
    c12=farbe_7,
    g13=flatten(kreisbogen.a),
    c13=farbe_12,
    g14=flatten(scheibenstapel.a),
    c14=farbe_19,
    g15=flatten(quader_mit_ausschnitt.a),
    c15=farbe_8,
    g16=flatten(l_profil.a),
    c16=farbe_14,
    g17=flatten(punktraster.a),
    c17=farbe_20)  # -> out, a, centers; inputs meshes: list of Mesh, sharpness: Double, blend_radius: Double, g0: list of GeometryBase, c0: Color, g1: list of GeometryBase, c1: Color, g2: list of GeometryBase, c2: Color, g3: list of GeometryBase, c3: Color, g4: list of GeometryBase, c4: Color, g5: list of GeometryBase, c5: Color, g6: list of GeometryBase, c6: Color, g7: list of GeometryBase, c7: Color, g8: list of GeometryBase, c8: Color, g9: list of GeometryBase, c9: Color, g10: list of GeometryBase, c10: Color, g11: list of GeometryBase, c11: Color, g12: list of GeometryBase, c12: Color, g13: list of GeometryBase, c13: Color, g14: list of GeometryBase, c14: Color, g15: list of GeometryBase, c15: Color, g16: list of GeometryBase, c16: Color, g17: list of GeometryBase, c17: Color
# ---------- farbverlauf_aus_regalelementen: Python ----------
import cdf.geometry_basics as geometry_basics

a, centers = geometry_basics.shelf_net_colors(
    meshes=meshes,
    groups=[g0,g1,g2,g3,g4,g5,g6,g7,g8,g9,g10,g11,g12,g13,g14,g15,g16,g17],
    colors=[c0,c1,c2,c3,c4,c5,c6,c7,c8,c9,c10,c11,c12,c13,c14,c15,c16,c17],
    sharpness=sharpness,blend_radius=blend_radius,
)
# ---------- end farbverlauf_aus_regalelementen ----------
netz_mit_farbverlauf = Mesh(farbverlauf_aus_regalelementen.a)

# ---- group: Bake complete shelf with colours
panel_2 = Panel("Bake everything")
complete_shelf_with_assigned_colours = Python3Script(
    geometry_0=flatten(kreisscheibe_mit_standkante.a),
    color_0=farbe_6,
    geometry_1=flatten(halbkreis.a),
    color_1=farbe_11,
    geometry_2=flatten(offener_ring.a),
    color_2=farbe_17,
    geometry_3=flatten(quader.a),
    color_3=farbe_5,
    geometry_4=flatten(kegel.a),
    color_4=farbe_9,
    geometry_5=flatten(kugel_mit_standflaeche.a),
    color_5=farbe_16,
    geometry_6=flatten(keil.a),
    color_6=farbe_4,
    geometry_7=flatten(raute.a),
    color_7=farbe_10,
    geometry_8=flatten(pyramide.a),
    color_8=farbe_15,
    geometry_9=flatten(rautenfeld_mit_attraktor.a),
    color_9=farbe_3,
    geometry_10=flatten(sinusband.a),
    color_10=farbe_13,
    geometry_11=flatten(strichreihe.a),
    color_11=farbe_18,
    geometry_12=flatten(staebe.a),
    color_12=farbe_7,
    geometry_13=flatten(kreisbogen.a),
    color_13=farbe_12,
    geometry_14=flatten(scheibenstapel.a),
    color_14=farbe_19,
    geometry_15=flatten(quader_mit_ausschnitt.a),
    color_15=farbe_8,
    geometry_16=flatten(l_profil.a),
    color_16=farbe_14,
    geometry_17=flatten(punktraster.a),
    color_17=farbe_20,
    boards=flatten(regalboeden.a),
    boards_color=farbe,
    frame=flatten(verbundene_rahmen_hoher_turm.a),
    frame_color=farbe_2,
    back_grid=flatten(farbverlauf_aus_regalelementen.a))  # -> out, geometry, colors, names; inputs geometry_0: list of GeometryBase, color_0: Color, geometry_1: list of GeometryBase, color_1: Color, geometry_2: list of GeometryBase, color_2: Color, geometry_3: list of GeometryBase, color_3: Color, geometry_4: list of GeometryBase, color_4: Color, geometry_5: list of GeometryBase, color_5: Color, geometry_6: list of GeometryBase, color_6: Color, geometry_7: list of GeometryBase, color_7: Color, geometry_8: list of GeometryBase, color_8: Color, geometry_9: list of GeometryBase, color_9: Color, geometry_10: list of GeometryBase, color_10: Color, geometry_11: list of GeometryBase, color_11: Color, geometry_12: list of GeometryBase, color_12: Color, geometry_13: list of GeometryBase, color_13: Color, geometry_14: list of GeometryBase, color_14: Color, geometry_15: list of GeometryBase, color_15: Color, geometry_16: list of GeometryBase, color_16: Color, geometry_17: list of GeometryBase, color_17: Color, boards: list of GeometryBase, boards_color: Color, frame: list of GeometryBase, frame_color: Color, back_grid: list of Mesh
# ---------- complete_shelf_with_assigned_colours: Python ----------
import cdf.geometry_basics as geometry_basics

geometry = []
colors = []
names = []
for item in geometry_0:
    if item is not None:
        geometry.append(item)
        colors.append(color_0)
        names.append('Kreisscheibe mit Standkante')
for item in geometry_1:
    if item is not None:
        geometry.append(item)
        colors.append(color_1)
        names.append('Halbkreis')
for item in geometry_2:
    if item is not None:
        geometry.append(item)
        colors.append(color_2)
        names.append('Offener Ring')
for item in geometry_3:
    if item is not None:
        geometry.append(item)
        colors.append(color_3)
        names.append('Quader')
for item in geometry_4:
    if item is not None:
        geometry.append(item)
        colors.append(color_4)
        names.append('Kegel')
for item in geometry_5:
    if item is not None:
        geometry.append(item)
        colors.append(color_5)
        names.append('Kugel mit Standflaeche')
for item in geometry_6:
    if item is not None:
        geometry.append(item)
        colors.append(color_6)
        names.append('Keil')
for item in geometry_7:
    if item is not None:
        geometry.append(item)
        colors.append(color_7)
        names.append('Raute')
for item in geometry_8:
    if item is not None:
        geometry.append(item)
        colors.append(color_8)
        names.append('Pyramide')
for item in geometry_9:
    if item is not None:
        geometry.append(item)
        colors.append(color_9)
        names.append('Rautenfeld mit Attraktor')
for item in geometry_10:
    if item is not None:
        geometry.append(item)
        colors.append(color_10)
        names.append('Sinusband')
for item in geometry_11:
    if item is not None:
        geometry.append(item)
        colors.append(color_11)
        names.append('Strichreihe')
for item in geometry_12:
    if item is not None:
        geometry.append(item)
        colors.append(color_12)
        names.append('Staebe')
for item in geometry_13:
    if item is not None:
        geometry.append(item)
        colors.append(color_13)
        names.append('Kreisbogen')
for item in geometry_14:
    if item is not None:
        geometry.append(item)
        colors.append(color_14)
        names.append('Scheibenstapel')
for item in geometry_15:
    if item is not None:
        geometry.append(item)
        colors.append(color_15)
        names.append('Quader mit Ausschnitt')
for item in geometry_16:
    if item is not None:
        geometry.append(item)
        colors.append(color_16)
        names.append('L-Profil')
for item in geometry_17:
    if item is not None:
        geometry.append(item)
        colors.append(color_17)
        names.append('Punktraster')

for parts, color, name in [(boards, boards_color, "Shelf boards"), (frame, frame_color, "Shelf frame")]:
    for item in parts:
        if item is not None:
            geometry.append(item)
            colors.append(color)
            names.append(name)
from System.Drawing import Color
for mesh in back_grid:
    if mesh is not None:
        geometry.append(mesh.DuplicateMesh())
        colors.append(Color.White)
        names.append("Back grid | vertex colour gradient")
# ---------- end complete_shelf_with_assigned_colours ----------
metal_roughness = Slider(0.28, range=0.05..0.7)
bake_complete_shelf = Button()
assigned_colours_and_polished_metal = Python3Script(
    colors=flatten(complete_shelf_with_assigned_colours.colors),
    names=flatten(complete_shelf_with_assigned_colours.names),
    roughness=metal_roughness,
    layer_name="Layer 01",
    geometry=flatten(complete_shelf_with_assigned_colours.geometry))  # -> out, attributes, material_names, render_geometry; inputs colors: list of Color, names: list of String, roughness: Double, layer_name: String, geometry: list of GeometryBase
# ---------- assigned_colours_and_polished_metal: Python ----------
import cdf.geometry_basics as geometry_basics

import Rhino
from System.Drawing import Color

rhino_doc = Rhino.RhinoDoc.ActiveDoc
layer_name = str(layer_name).strip() or "Shelf objects"
attributes = []
material_names = []
if len(colors) != len(names):
    raise ValueError("Colours and object names must match.")
layer_index = rhino_doc.Layers.FindByFullPath(layer_name, -1)
if layer_index < 0:
    layer_index = rhino_doc.Layers.AddPath(layer_name)
for color, name in zip(colors, names):
    material_name = "Shelf metal | %02X%02X%02X | roughness %.3f" % (color.R, color.G, color.B, roughness)
    index = next((m.MaterialIndex for m in rhino_doc.Materials if not m.IsDeleted and m.Name == material_name), -1)
    if index < 0:
        material = Rhino.DocObjects.Material()
        material.Name = material_name
        material.DiffuseColor = color
        material.ToPhysicallyBased()
        pbr = material.PhysicallyBased
        pbr.BaseColor = Rhino.Display.Color4f(color)
        pbr.Metallic = 1.0
        pbr.Roughness = roughness
        pbr.Opacity = 1.0
        pbr.SynchronizeLegacyMaterial()
        index = rhino_doc.Materials.Add(material)
    attr = Rhino.DocObjects.ObjectAttributes()
    attr.Name = name
    attr.LayerIndex = layer_index
    attr.ObjectColor = color
    attr.ColorSource = Rhino.DocObjects.ObjectColorSource.ColorFromObject
    attr.MaterialIndex = index
    attr.MaterialSource = Rhino.DocObjects.ObjectMaterialSource.MaterialFromObject
    attributes.append(attr)
    material_names.append(material_name)

render_geometry = list(geometry)
grid_indices = [i for i,n in enumerate(names) if n.startswith("Back grid")]
if grid_indices:
    meshes, grid_attributes = geometry_basics.shelf_grid_render_materials(
        meshes=[geometry[i] for i in grid_indices],
        attributes=[attributes[i] for i in grid_indices],
        rhino_doc=rhino_doc,
        texture_folder="/Users/spukki/Documents/Codex/2026-11-02/i-have-the-task-in-coputational-2/outputs/GridTextures",
        roughness=roughness,
    )
    for i, mesh, attr in zip(grid_indices, meshes, grid_attributes):
        render_geometry[i] = mesh
        attributes[i] = attr
# ---------- end assigned_colours_and_polished_metal ----------
bake_complete_shelf_2 = BakeGeometry(
    Bake=bake_complete_shelf,
    Geometry=assigned_colours_and_polished_metal.render_geometry,
    Attributes=assigned_colours_and_polished_metal.attributes,
    DeleteOldBakes=False,
    PreserveTrees=False)
