# Grasshopper definition geometry_basics.ghx (Grasshopper 1.0.8)

# ---- group: Example: Build a Parametric Cone
pt = Point(Point(-0.4439523925, 0.05137995213, 0))
number_slider = Slider(1, range=1..10)
cone = Python3Script(pt=pt, h=number_slider, r=Slider(1, range=1..10))  # -> out, my_cone; inputs pt: Point3d
# ---------- cone: Python ----------
# import function
from cdf import create_cone

# call function
my_cone = create_cone(base_point=pt, height=h, radius=r)
# ---------- end cone ----------

# ---- group: Auto-reloads cdf module on VScode changes
# Setting path for Src AutoReloader: 1. Right click on Path
# 2. Choose "Select a directory"
# 3. Locate the ..\cdf1_teaching\src folder in your computer
# NOTES:
# 
# - Use Python 3 Script blocks for your functions.
# - Import your functions and classes as: from cdf import my_function, My_class
# - Don't forget to add and name your INPUT and OUTPUT parameters that match your functions correctly. If you zoom in to the Python component you will see the + sign to add and - to remove them.
# - You need to attach the accurate components to your INPUT parameters: sliders for integers or floats, toggles or buttons for booleans, text for strings, Rhino geometries etc. etc.
# - If an INPUT is  a list, you need to right-click the parameter to set it as LIST access. Sometimes you need to also set the type of the INPUT by clicking TYPE HINT and selecting the correct input type.
# - If you want to hide an object, right-click component and uncheck Preview. To visualize again, check Preview.
# - If you get errors, READ THEM! They often tell what's wrong in a simple language. If not, copy-paste to CoPilot and don't be afraid to play around!
# 
# For more Grasshopper Help, go to:
# https://developer.rhino3d.com/guides/scripting/scripting-component/#script-inputs-and-outputs
path = FilePath("/Users/spukki/Documents/GitHub/cdf1_teaching/src/")
autoreloader = Python3Script(src_path=path)  # -> out; inputs src_path: String
# ---------- autoreloader: Python ----------
#! python3
import sys, os, time
import scriptcontext as sc
import Rhino, System
from System.IO import FileSystemWatcher, NotifyFilters

VERSION = 1  
pkg = "cdf"

if not src_path:
    raise Exception("Connect a folder to src_path.")
path = os.path.normpath(src_path)
watch_dir = os.path.join(path, pkg)
if not os.path.isdir(watch_dir):
    raise Exception("No '{}' folder found in:\n{}".format(pkg, path))

def unload():
    for name in list(sys.modules):
        if name == pkg or name.startswith(pkg + "."):
            del sys.modules[name]

# Put this folder first in Python's search list
if path in sys.path:
    sys.path.remove(path)
sys.path.insert(0, path)

key = "cdf_watcher_" + str(ghenv.Component.InstanceGuid)
time_key = key + "_time"
version_key = key + "_version"

def stamp():
    sc.sticky[time_key] = time.strftime("%Y-%m-%d %H:%M:%S")

# Replace the old watcher if the folder changed or the script was updated
old = sc.sticky.get(key)
if old is not None and (os.path.normpath(old.Path) != watch_dir
                        or sc.sticky.get(version_key) != VERSION):
    old.Dispose()
    del sc.sticky[key]
    unload()

if key not in sc.sticky:
    comp = ghenv.Component
    last = [0.0]

    def reload_and_rerun():
        unload()
        stamp()
        doc = comp.OnPingDocument()
        if doc is None:            # reloader was deleted or the file closed
            return
        for obj in doc.Objects:
            if "Python" in obj.GetType().Name:
                obj.ExpireSolution(False)   # mark as out of date
        doc.NewSolution(False)              # recompute once

    def on_change(sender, e):
        if not e.FullPath.endswith(".py") or "__pycache__" in e.FullPath:
            return
        if time.time() - last[0] < 0.5:     # ignore the second event of a double save
            return
        last[0] = time.time()
        Rhino.RhinoApp.InvokeOnUiThread(System.Action(reload_and_rerun))

    w = FileSystemWatcher(watch_dir, "*.py")
    w.IncludeSubdirectories = True
    w.NotifyFilter = NotifyFilters.LastWrite
    w.Changed += on_change
    w.EnableRaisingEvents = True
    sc.sticky[key] = w
    sc.sticky[version_key] = VERSION
    stamp()                                  # time the watcher started

msg = "Last reloaded: {}\nWatching: {}".format(sc.sticky.get(time_key, "unknown"), watch_dir)
print(msg)
out = msg
# ---------- end autoreloader ----------
panel = Panel(autoreloader)

# ---- group: TODO: Build a Parametric Sphere
sphere = Python3Script(pt=pt, r=number_slider)  # -> out, a; inputs pt: Point3d
# ---------- sphere: Python ----------
from cdf import create_sphere

a = create_sphere(center_point=pt, radius=r)
# ---------- end sphere ----------

# ---- group: TODO: Make Transformations
transformation = Python3Script(my_sphere=sphere.a, distance=Slider(3, range=1..10), count=Slider(2, range=1..10))  # -> out, my_spheres; inputs my_sphere: Brep
# ---------- transformation: Python ----------
from cdf import copy_brep_along_z

my_spheres = copy_brep_along_z(my_sphere, distance, count)
# ---------- end transformation ----------

# ---- group: TODO: Make a Boolean Difference
boolean = Python3Script(I1=cone.my_cone, I2=sphere.a)  # -> out, result_geometry; inputs I1: Brep, I2: Brep
# ---------- boolean: Python ----------
from cdf import boolean_difference

result_geometry = boolean_difference(I1, I2)
# ---------- end boolean ----------

# ---- group: Visualize
preview = CustomPreview(Geometry=cone.my_cone, Material=ColourSwatch(SwatchColor=RGB(60, 230, 88)))

preview_2 = CustomPreview(Geometry=sphere.a, Material=ColourSwatch(SwatchColor=RGB(255, 86, 88)))

preview_3 = CustomPreview(Geometry=boolean.result_geometry, Material=ColourSwatch(SwatchColor=RGB(255, 86, 255)))

preview_4 = CustomPreview(Geometry=transformation.my_spheres, Material=ColourSwatch(SwatchColor=RGB(255, 255, 96)))

# ---- group: Base Rectangle
unit_x = UnitX(Factor=Slider(30, range=0..100))
unit_y = UnitY(Factor=Slider(40, range=0..100))
pt_2 = Point(Point(0, 0, 0))
move = Move(Geometry=pt_2, Motion=unit_x)  # -> Geometry, Transform
move_2 = Move(Geometry=move.Geometry, Motion=unit_y)  # -> Geometry, Transform
rectangle_2pt = Rectangle2Pt(Plane=pt_2, PointA=pt_2, PointB=move_2.Geometry, Radius=0)  # -> Rectangle, Length
surface = Surface(rectangle_2pt.Rectangle)

# ---- group: lines
unit_y_2 = UnitY(Factor=Slider(10, range=0..10))
point = Point(Point(19, 33, 0))
point_2 = Point(Point(15, 34, 0))
point_3 = Point(Point(17, 31, 0))
point_4 = Point(Point(21, 31, 0))
negative = Negative(Value=unit_y_2)
move_3 = Move(Geometry=[point, point_3, point_2, point_4], Motion=negative)  # -> Geometry, Transform
line = Line(StartPoint=[point, point_3, point_2, point_4], EndPoint=move_3.Geometry)
python_3_script = Python3Script(rail=line, r=Slider(0.31, range=0..0.5))  # -> out, a; inputs rail: Curve
# ---------- python_3_script: Python ----------
from cdf import create_pipe

a = create_pipe(rail_curve=rail, radius=r)
# ---------- end python_3_script ----------

# ----
custom_preview = CustomPreview(Geometry=surface, Material=ColourSwatch(SwatchColor=RGB(255, 171, 171)))

# ---- group: dashed_lines
point_5 = Point(Point(11, 6, 0))
point_6 = Point(Point(13, 4, 0))
point_7 = Point(Point(12, 7, 0))
unit_y_3 = UnitY(Factor=Slider(10, range=0..10))
move_4 = Move(Geometry=[point_5, point_7, point_6], Motion=unit_y_3)  # -> Geometry, Transform
python_3_script_2 = Python3Script(
    start_point=[point_5, point_7, point_6],
    end_point=move_4.Geometry,
    dash_length=Slider(0.9, range=0..10),
    gap_length=Slider(1, range=0..10))  # -> out, a; inputs start_point: Point3d, end_point: Point3d, dash_length: Double, gap_length: Double
# ---------- python_3_script_2: Python ----------
import cdf.geometry_basics as geometry_basics

a = geometry_basics.create_dashed_line(
    start_point=start_point,
    end_point=end_point,
    dash_length=dash_length,
    gap_length=gap_length,
)
# ---------- end python_3_script_2 ----------

# ---- group: diamonds
point_8 = Point(Point(20, 21, 0))
point_9 = Point(Point(20, 26, 0))
python_3_script_3 = Python3Script(
    start_point=point_8,
    diamond_width=Slider(4.4, range=0..5),
    diamond_height=Slider(2.5, range=0..5),
    rows=Slider(5, range=0..10),
    columns=Slider(5, range=0..10),
    pull_point=point_9,
    distance_from=Slider(0.7, range=0..10),
    distance_to=Slider(5.4, range=0..10),
    gap_near=Slider(0.9, range=0..10),
    gap_far=Slider(1.6, range=0..10))  # -> out, a; inputs start_point: Point3d, diamond_width: Double, diamond_height: Double, rows: Int32, columns: Int32, pull_point: Point3d, distance_from: Double, distance_to: Double, gap_near: Double, gap_far: Double
# ---------- python_3_script_3: Python ----------
import cdf.geometry_basics as geometry_basics

a = geometry_basics.create_diamond_attractor_gaps(
    start_point=start_point,
    diamond_width=diamond_width,
    diamond_height=diamond_height,
    rows=rows,
    columns=columns,
    pull_point=pull_point,
    distance_from=distance_from,
    distance_to=distance_to,
    gap_near=gap_near,
    gap_far=gap_far,
)
# ---------- end python_3_script_3 ----------
point_10 = Point(Point(20, 21, 0))
python_3_script_4 = Python3Script(
    start_point=point_10,
    diamond_width=Slider(4.3, range=0..10),
    diamond_height=Slider(2.1, range=0..5),
    gap=python_3_script_3.a,
    rows=Slider(5, range=0..10),
    columns=Slider(5, range=0..10))  # -> out, a; inputs start_point: Point3d, diamond_width: Double, diamond_height: Double, gap: list, rows: Int32, columns: Int32
# ---------- python_3_script_4: Python ----------
import cdf.geometry_basics as geometry_basics

a = geometry_basics.create_diamond_pattern(
    start_point=start_point,
    diamond_width=diamond_width,
    diamond_height=diamond_height,
    gap=gap,
    rows=rows,
    columns=columns,
)
# ---------- end python_3_script_4 ----------
geometry = Geometry(python_3_script_4.a)
python_3_script_5 = Python3Script(surfaces=geometry, height=Slider(0.2, range=0..5))  # -> out, a; inputs surfaces: list of Surface, height: Double
# ---------- python_3_script_5: Python ----------
import cdf.geometry_basics as geometry_basics

a = geometry_basics.create_pyramids_from_surfaces(
    surfaces=surfaces,
    height=height,
)
# ---------- end python_3_script_5 ----------

# ---- group: box
point_11 = Point(Point(17, 16, 0))
python_3_script_6 = Python3Script(base_point=point_11, x=Slider(7, range=0..10), y=Slider(3, range=0..10), z=Slider(2, range=0..10))  # -> out, a; inputs base_point: Point3d, x: Int32, y: Int32, z: Int32
# ---------- python_3_script_6: Python ----------
import cdf.geometry_basics as geometry_basics

a = geometry_basics.create_box(
    base_point=base_point,
    x_size=x,
    y_size=y,
    z_size=z,
)
# ---------- end python_3_script_6 ----------

point_12 = Point(Point(11, 20, 0))
python_3_script_7 = Python3Script(base_point=point_12, x=Slider(4, range=0..10), y=Slider(10, range=0..10), z=Slider(1.6, range=0..10))  # -> out, a; inputs base_point: Point3d, x: Double, y: Double, z: Double; same code as python_3_script_6

point_13 = Point(Point(16, 10, 0))
python_3_script_8 = Python3Script(base_point=point_13, x=Slider(4, range=0..10), y=Slider(10, range=0..10), z=Slider(0.2, range=0..10))  # -> out, a; inputs base_point: Point3d, x: Double, y: Double, z: Double; same code as python_3_script_6

# ---- group: Circle
point_14 = Point(Point(14, 17, 0))
python_3_script_9 = Python3Script(pt=point_14, r=Slider(4.9, range=0..10))  # -> out, a; inputs pt: Point3d
# ---------- python_3_script_9: Python ----------
from cdf import create_circle

a = create_circle(center_point=pt, radius=r)
# ---------- end python_3_script_9 ----------
python_3_script_10 = Python3Script(profile=python_3_script_9.a, h=Slider(1, range=0..1))  # -> out, a; inputs profile: Curve
# ---------- python_3_script_10: Python ----------
from cdf import extrude_curve

a = extrude_curve(profile_curve=profile, height=h)
# ---------- end python_3_script_10 ----------

point_15 = Point(Point(10, 30, 0))
python_3_script_11 = Python3Script(pt=point_15, r=Slider(2.8, range=0..10))  # -> out, a; inputs pt: Point3d; same code as python_3_script_9
python_3_script_12 = Python3Script(profile=python_3_script_11.a, h=Slider(0.9, range=0..2))  # -> out, a; inputs profile: Curve; same code as python_3_script_10

point_16 = Point(Point(24, 22, 0))
python_3_script_13 = Python3Script(pt=point_16, r=Slider(2, range=0..10))  # -> out, a; inputs pt: Point3d; same code as python_3_script_9
python_3_script_14 = Python3Script(profile=python_3_script_13.a, h=Slider(0.5, range=0..2))  # -> out, a; inputs profile: Curve; same code as python_3_script_10

# ---- group: sinus
point_17 = Point(Point(8, 12, 0))
unit_x_2 = UnitX(Factor=1)
unit_y_4 = UnitY(Factor=1)
python_3_script_15 = Python3Script(
    length=Slider(18, range=0..100),
    amplitude=Slider(2.1, range=0..5),
    wavelength=Slider(5, range=0..5),
    direction=unit_x_2,
    wave_direction=unit_y_4,
    start_point=point_17,
    phase=Slider(0, range=0..5),
    sample_count=Slider(10, range=0..10))  # -> out, a; inputs length: Double, amplitude: Double, wavelength: Double, start_point: Point3d, phase: Double, sample_count: Int32
# ---------- python_3_script_15: Python ----------
import cdf.geometry_basics as geometry_basics

a = geometry_basics.create_sine_curve(
    length=length,
    amplitude=amplitude,
    wavelength=wavelength,
    direction=direction,
    wave_direction=wave_direction,
    start_point=start_point,
    phase=phase,
    sample_count=sample_count,
)
# ---------- end python_3_script_15 ----------

# ---- group: lines
point_18 = Point(Point(6, 25, 0))
python_3_script_16 = Python3Script(pt=point_18, axis="x", l=Slider(6, range=0..10))  # -> out, a; inputs pt: Point3d
# ---------- python_3_script_16: Python ----------
from cdf import create_axis_line

a = create_axis_line(start_point=pt, axis=axis, length=l)
# ---------- end python_3_script_16 ----------
offset_curve = OffsetCurve(Curve=python_3_script_16.a, Distance=[Slider(1, range=0..10), Slider(2, range=0..10)], Corners=1)
python_3_script_17 = Python3Script(rail=[python_3_script_16.a, offset_curve], r=Slider(0.1, range=0..0.5))  # -> out, a; inputs rail: Curve; same code as python_3_script

# ---- group: sphere
point_19 = Point(Point(22, 17, 0))
sphere_2 = Python3Script(pt=point_19, r=Slider(1.5, range=0..5))  # -> out, a; inputs pt: Point3d; same code as sphere

# ---- group: box
negative_2 = Negative(Value=Slider(8, range=0..10))
python_3_script_18 = Python3Script(base_point=point_14, x=negative_2, y=Slider(8, range=0..10), z=Slider(5, range=0..10))  # -> out, a; inputs base_point: Point3d, x: Int32, y: Int32, z: Int32; same code as python_3_script_6

# ----
boolean_2 = Python3Script(I1=python_3_script_6.a, I2=sphere_2.a)  # -> out, result_geometry; inputs I1: Brep, I2: Brep; same code as boolean

# ---- group: offset_extrusion
curve = Curve(python_3_script_2.a)
python_3_script_19 = Python3Script(curves=curve, offset_distance=Slider(0.3, range=0..10), extrusion_height=Slider(0.3, range=0..10))  # -> out, a; inputs curves: list of Curve, offset_distance: Double, extrusion_height: Double
# ---------- python_3_script_19: Python ----------
import cdf.geometry_basics as geometry_basics

a = geometry_basics.offset_loft_extrude_curves(
    curves=curves,
    offset_distance=offset_distance,
    extrusion_height=extrusion_height,
)
# ---------- end python_3_script_19 ----------

curve_2 = Curve(python_3_script_15.a)
python_3_script_20 = Python3Script(curves=curve_2, offset_distance=Slider(0.4, range=0..10), extrusion_height=Slider(0.5, range=0..10))  # -> out, a; inputs curves: list of Curve, offset_distance: Double, extrusion_height: Double; same code as python_3_script_19

# ----
boolean_3 = Python3Script(I1=python_3_script_10.a, I2=python_3_script_18.a)  # -> out, result_geometry; inputs I1: Brep, I2: Brep; same code as boolean
boolean_4 = Python3Script(I1=boolean_2.result_geometry, I2=python_3_script_10.a)  # -> out, result_geometry; inputs I1: Brep, I2: Brep; same code as boolean
merge = Merge(
    Data2=python_3_script_17.a,
    Data3=python_3_script.a,
    Data4=python_3_script_12.a,
    Data5=python_3_script_14.a,
    Data7=boolean_3.result_geometry,
    Data8=boolean_4.result_geometry,
    Data9=python_3_script_7.a,
    Data10=python_3_script_8.a,
    Data11=python_3_script_19.a,
    Data12=python_3_script_20.a,
    Data13=python_3_script_5.a)
point_20 = Point(Point(8, 12, 0))
colour_swatch = ColourSwatch(SwatchColor=RGB(255, 10, 255))
python_3_script_21 = Python3Script(
    geometry=merge,
    attractor_point=point_20,
    near_color=ColourSwatch(SwatchColor=RGB(255, 0, 255)),
    far_color=ColourSwatch(SwatchColor=RGB(255, 0, 0)),
    distance=Slider(7, range=0..20))  # -> m, a; inputs geometry: list of Brep, attractor_point: Point3d, distance: Int32
# ---------- python_3_script_21: Python ----------
import importlib
import cdf.geometry_basics as geometry_basics
importlib.reload(geometry_basics)

a, m = geometry_basics.prepare_custom_preview(
    geometry=geometry,
    attractor_point=attractor_point,
    near_color=near_color,
    far_color=far_color,
    distance=distance,
)
# ---------- end python_3_script_21 ----------
custom_preview_2 = CustomPreview(Geometry=python_3_script_21.a, Material=python_3_script_21.m)
